# Grasshopper definition ToTrace.gh (Grasshopper 1.0.7)
# plug-ins: TOtracing

totr = TOtracing(Xlength=Slider(10, range=0..100), Ylength=Slider(5, range=0..100), Iteration="1", Volfrac="0.5")
pt = Point(Point(-1, -1, 0))
move = Move(Geometry=totr, Motion=pt)  # -> Geometry, Transform
pipe = Pipe(Radius=1, Caps=0)  # disabled
